# Grasshopper definition auto-outputer.gh (Grasshopper 1.0.8)
# Copyright: MIT

panel = Panel("https://github.com/pdanahy3/IASS-2026-SecondLives/blob/main/Test-csv/harmonized_source_A_gsr_reno_hss_6cols_cost.csv")
panel_2 = Panel("https://github.com/pdanahy3/IASS-2026-SecondLives/blob/main/Test-csv/harmonized_source_A_gsr_reno_hss_8cols_cost.csv")
panel_3 = Panel("https://github.com/pdanahy3/IASS-2026-SecondLives/blob/main/Test-csv/harmonized_source_A_gsr_reno_hss_cost.csv")
panel_4 = Panel("https://github.com/pdanahy3/IASS-2026-SecondLives/blob/main/Test-csv/harmonized_source_A_gsr_reno_hss.csv")
entwine = Entwine(Branch00=panel, Branch01=panel_2, Branch02=panel_3, Branch03=panel_4, FlattenInputs=True)  # -> flatten(Result)
item = ListItem(List=entwine, Index=Slider(3, range=0..5), Wrap=True)
panel_5 = Panel(item)

# ---- group: html Github Repositray
csv_reader = GitHubCSVReader(Repository=item, Refresh=Button())  # -> element_id, source, material_type, section_or_species, length_ft, reusable_length_ft, mass_kg, percent_reusable, embodied_carbon_savings_kgco2e; inputs Repository: String
#   port element_id: CSV column: element_id
#   port source: CSV column: source
#   port material_type: CSV column: material_type
#   port section_or_species: CSV column: section_or_species
#   port length_ft: CSV column: length_ft
#   port reusable_length_ft: CSV column: reusable_length_ft
#   port mass_kg: CSV column: mass_kg
#   port percent_reusable: CSV column: percent_reusable
#   port embodied_carbon_savings_kgco2e: CSV column: embodied_carbon_savings_kgco2e
# ---------- csv_reader: Python ----------
"""Grasshopper Python 3 component

Inputs:
    Repository : GitHub repository, CSV URL, or local CSV path
    Refresh    : Boolean button
"""

import csv
import io
import json
import keyword
import os
import re
import urllib.request

import Grasshopper.Kernel as ghk
import System
import scriptcontext as sc
import clr

clr.AddReference("RhinoCodePluginGH")
from RhinoCodePluginGH.Parameters import ScriptVariableParam


component = ghenv.Component
component.Name = "GitHub CSV Reader"
component.NickName = "CSV Reader"
component.Message = "Dynamic CSV outputs"

CACHE_PREFIX = "dynamic_csv_reader_"


# ------------------------------------------------------------
# Utility
# ------------------------------------------------------------

def warning(message):
    component.AddRuntimeMessage(
        ghk.GH_RuntimeMessageLevel.Warning,
        str(message)
    )


def error(message):
    component.AddRuntimeMessage(
        ghk.GH_RuntimeMessageLevel.Error,
        str(message)
    )


def request_text(url):
    request = urllib.request.Request(
        url,
        headers={"User-Agent": "Rhino-Grasshopper-CSV-Reader"}
    )

    with urllib.request.urlopen(request, timeout=20) as response:
        return response.read().decode("utf-8-sig")


def github_csv_url(repository):
    """
    Supported GitHub formats:

    https://github.com/owner/repository
    https://github.com/owner/repository/blob/main/data/file.csv
    https://raw.githubusercontent.com/owner/repository/main/data/file.csv

    A repository root is accepted only when it contains exactly one CSV.
    """

    repository = repository.strip()

    # Already a raw CSV URL
    if "raw.githubusercontent.com" in repository:
        return repository

    # GitHub blob page
    if "github.com" in repository and "/blob/" in repository:
        return repository.replace(
            "https://github.com/",
            "https://raw.githubusercontent.com/"
        ).replace("/blob/", "/")

    # GitHub repository root
    match = re.match(
        r"https?://github\.com/([^/]+)/([^/#]+?)(?:\.git)?/?$",
        repository
    )

    if not match:
        return repository

    owner = match.group(1)
    repo = match.group(2)

    # Determine default branch
    repo_api = "https://api.github.com/repos/{}/{}".format(owner, repo)
    repo_information = json.loads(request_text(repo_api))
    branch = repo_information["default_branch"]

    # Inspect complete repository tree
    tree_api = (
        "https://api.github.com/repos/{}/{}/git/trees/{}?recursive=1"
        .format(owner, repo, branch)
    )

    tree_information = json.loads(request_text(tree_api))

    csv_files = [
        item["path"]
        for item in tree_information.get("tree", [])
        if item.get("type") == "blob"
        and item.get("path", "").lower().endswith(".csv")
    ]

    if len(csv_files) == 0:
        raise ValueError("No CSV file was found in the repository.")

    if len(csv_files) > 1:
        files = "\n".join(csv_files[:15])

        raise ValueError(
            "The repository contains multiple CSV files.\n"
            "Connect the GitHub URL of the specific CSV file instead:\n\n"
            + files
        )

    return (
        "https://raw.githubusercontent.com/"
        "{}/{}/{}/{}"
        .format(owner, repo, branch, csv_files[0])
    )


def read_source(repository, force_refresh):
    """
    Download once and keep the CSV in the Grasshopper session cache.
    The Refresh button forces a new download.
    """

    source = github_csv_url(repository)
    cache_key = CACHE_PREFIX + source

    if not force_refresh and cache_key in sc.sticky:
        return sc.sticky[cache_key], source, True

    if source.lower().startswith(("http://", "https://")):
        text = request_text(source)

    elif os.path.isfile(source):
        with open(source, "r", encoding="utf-8-sig", newline="") as file:
            text = file.read()

    else:
        raise ValueError(
            "Repository must be a valid GitHub URL, raw CSV URL, "
            "GitHub CSV page, or local CSV path."
        )

    sc.sticky[cache_key] = text
    return text, source, False


def convert_value(value):
    """Convert CSV strings into useful Grasshopper values."""

    if value is None:
        return None

    value = value.strip()

    if value == "":
        return None

    lower = value.lower()

    if lower in ("true", "yes"):
        return True

    if lower in ("false", "no"):
        return False

    # Preserve identifiers containing leading zeros
    if re.match(r"^[-+]?\d+$", value):
        unsigned = value.lstrip("+-")

        if len(unsigned) == 1 or not unsigned.startswith("0"):
            try:
                return int(value)
            except Exception:
                pass

    try:
        return float(value)
    except Exception:
        return value


def safe_output_name(header, used_names):
    """
    Make a CSV header suitable for a Grasshopper/Python output nickname.
    The visible full output name remains the original CSV header.
    """

    name = re.sub(r"\W+", "_", header.strip())
    name = name.strip("_")

    if not name:
        name = "Column"

    if name[0].isdigit():
        name = "Column_" + name

    if keyword.iskeyword(name):
        name = name + "_data"

    if name in ("Repository", "Refresh"):
        name = name + "_output"

    base = name
    counter = 2

    while name.lower() in used_names:
        name = "{}_{}".format(base, counter)
        counter += 1

    used_names.add(name.lower())
    return name


# ------------------------------------------------------------
# Dynamic Grasshopper outputs
# ------------------------------------------------------------

def schedule_output_update(headers, nicknames):
    """
    Rebuild the Rhino 8 Python component outputs using
    ScriptVariableParam.
    """

    def update_outputs(document):
        # Remove old outputs
        existing_outputs = list(component.Params.Output)

        for parameter in reversed(existing_outputs):
            component.Params.UnregisterOutputParameter(parameter)

        # Create one native Rhino 8 script output per CSV column
        for header, nickname in zip(headers, nicknames):
            parameter = ScriptVariableParam(nickname)

            # Internal Python variable = nickname
            # Visible Grasshopper name = original CSV header
            parameter.PrettyName = header
            parameter.ToolTip = "CSV column: {}".format(header)
            parameter.Access = ghk.GH_ParamAccess.list
            parameter.AllowTreeAccess = True

            parameter.CreateAttributes()
            component.Params.RegisterOutputParam(parameter)

        # Required for Rhino 8 script components
        component.VariableParameterMaintenance()
        component.Params.OnParametersChanged()
        component.ExpireSolution(False)

    document = component.OnPingDocument()

    if document is None:
        raise ValueError(
            "The Python component is not connected to a "
            "Grasshopper document."
        )

    document.ScheduleSolution(5, update_outputs)

# ------------------------------------------------------------
# Main
# ------------------------------------------------------------

try:
    if not Repository:
        raise ValueError("Connect a GitHub repository or CSV URL.")

    csv_text, resolved_source, used_cache = read_source(
        str(Repository),
        bool(Refresh)
    )

    reader = csv.DictReader(io.StringIO(csv_text))

    if not reader.fieldnames:
        raise ValueError("The CSV does not contain a header row.")

    headers = [str(header).strip() for header in reader.fieldnames]

    if len(set(headers)) != len(headers):
        raise ValueError("The CSV contains duplicate column headers.")

    rows = list(reader)

    used_names = set()
    nicknames = [
        safe_output_name(header, used_names)
        for header in headers
    ]

    current_variables = [
        parameter.Name
        for parameter in component.Params.Output
    ]

    # First solution: create or update the output sockets
    if current_variables != headers:
        schedule_output_update(headers, nicknames)

    # Second solution: populate each output
    else:
        for header, nickname in zip(headers, nicknames):
            values = [
                convert_value(row.get(header))
                for row in rows
            ]

            globals()[nickname] = values

        component.Message = "{} rows · {} columns".format(
            len(rows),
            len(headers)
        )

except Exception as exception:
    component.Message = "Import error"
    error(exception)

    # Prevent old data remaining visible after an import error
    for parameter in component.Params.Output:
        globals()[parameter.Name] = []
# ---------- end csv_reader ----------

# ----
panel_6 = Panel(csv_reader.section_or_species)
