# Grasshopper definition truss_generator.gh (Grasshopper 1.0.8)
# plug-ins: Karamba3D

list = ValueList({"Warren", "Pratt", "Howe", "Fink"}, selected="Howe")
crv = Curve([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])
crosec = CrossSectionKaramba3D(
    FamilyNameOfCrossSection="DefaultCroSec",
    Height_cm=9.6,
    UpperFlangeWidth_cm=10,
    LowerFlangeWidth_cm=10,
    UpperFlangeThickness_cm=0.8,
    LowerFlangeThickness_cm=0.8,
    WebThickness_cm=0.5,
    FilletRadius_cm=0,
    mode="I")  # disabled
number_slider = Slider(3, range=0..100)  # disabled
number_slider_2 = Slider(4, range=0..100)  # disabled
number_slider_3 = Slider(10, range=0..100)  # disabled
number_slider_4 = Slider(10, range=0..100)  # disabled
c_script = CSharpScript(Curves=crv, TrussType=list)  # -> Truss, ReuseRatio, Variation; inputs Curves: list of Curve, Seed: Int32, TrussType: String, WReuse: Double, WFit: Double, WCost: Double, WEnergy: Double
# ---------- c_script: C# ----------
// Grasshopper Script Instance
// Inputs:  Curves, Seed, TrussType,
//          WReuse, WFit, WCost, WEnergy  (0–1+ weights; item, number)
// Outputs: Truss (list), ReuseRatio (item), Variation (item)
// Value List items: Warren, Pratt, Howe, Fink
// One truss per input curve; adjacent trusses get laterals + X-bracing
// Truss output: 3D meshes using true HSS/W sections from Source A
// Reads steel_cost_dataset_package: inventory + depots + trip cost parameters
// Weights steer stock matching and panel count:
//   WReuse  = cover the truss from inventory
//   WFit    = stock length alignment to designed members
//   WCost   = depot location + material/transport GBP
//   WEnergy = embodied-carbon savings vs haul (t·km)
// Seed 0 = optimized under those weights

#region Usings
using System;
using System.Linq;
using System.Collections;
using System.Collections.Generic;
using System.Drawing;
using System.Globalization;
using System.IO;
using System.Text;

using Rhino;
using Rhino.Geometry;
using Rhino.Display;

using Grasshopper;
using Grasshopper.Kernel;
using Grasshopper.Kernel.Data;
using Grasshopper.Kernel.Types;
#endregion

public class Script_Instance : GH_ScriptInstance
{
    #region Notes
    /*
      Members:
        RhinoDoc RhinoDocument
        GH_Document GrasshopperDocument
        IGH_Component Component
        int Iteration

      Methods (Virtual & overridable):
        Print(string text)
        Print(string format, params object[] args)
        Reflect(object obj)
        Reflect(object obj, string method_name)
    */
    #endregion

    private List<Mesh> _meshMatched;
    private List<Mesh> _meshBrace;
    private List<Mesh> _meshUnmatched;
    private List<Curve> _chords;

    private void RunScript(
		List<Curve> Curves,
		int Seed,
		string TrussType,
		double WReuse,
		double WFit,
		double WCost,
		double WEnergy,
		ref object Truss,
		ref object ReuseRatio,
		ref object Variation)
    {
        _meshMatched = new List<Mesh>();
        _meshBrace = new List<Mesh>();
        _meshUnmatched = new List<Mesh>();
        _chords = new List<Curve>();

        if (Curves == null || Curves.Count == 0)
        {
            Print("Input one or more chord curves from Rhino.");
            ReuseRatio = 0.0;
            Variation = 0.0;
            Truss = new List<Mesh>();
            return;
        }

        var live = new List<Curve>();
        for (int i = 0; i < Curves.Count; i++)
        {
            if (Curves[i] != null && Curves[i].IsValid && Curves[i].GetLength() > 1e-6)
                live.Add(Curves[i].DuplicateCurve());
        }
        if (live.Count == 0)
        {
            Print("No valid curves.");
            ReuseRatio = 0.0;
            Variation = 0.0;
            Truss = new List<Mesh>();
            return;
        }

        string dataFolder;
        var stock = Inventory.Load(FindCostFolder(out dataFolder));
        if (stock.Count == 0)
        {
            Print("No reusable, transport-eligible HSS found. Folder: " + dataFolder);
            ReuseRatio = 0.0;
            Variation = 0.0;
            Truss = new List<Mesh>();
            return;
        }

        Weights weights = Weights.From(WReuse, WFit, WCost, WEnergy);
        string kind = TrussBuilder.NormalizeType(TrussType);
        List<Curve> ordered = FrameLayout.OrderAndAlign(live);
        List<ChordPair> frames = ChordPair.FromEachCurve(ordered, RhinoDocument);
        for (int i = 0; i < frames.Count; i++)
        {
            _chords.Add(frames[i].Bottom);
            _chords.Add(frames[i].Top);
        }

        int nOpt = TrussBuilder.BestPanelCount(kind, frames, stock, weights);
        int nUse = nOpt;
        if (Seed != 0)
        {
            nUse = nOpt + (((Seed * 1103515245 + 12345) >> 16) % 5) - 2;
            nUse = TrussBuilder.ClampPanels(kind, nUse);
        }

        List<Member> optMembers = TrussBuilder.BuildSystem(kind, frames, nOpt);
        AssignResult opt = Assigner.BestFit(optMembers, stock, weights);

        List<Member> members = (Seed == 0)
            ? optMembers
            : TrussBuilder.BuildSystem(kind, frames, nUse);
        AssignResult current = (Seed == 0)
            ? opt
            : Assigner.Seeded(members, stock, Seed, weights);

        var meshes = new List<Mesh>();
        int braceCount = 0;
        int meshed = 0;
        double inch = 0.0254;
        for (int i = 0; i < members.Count; i++)
        {
            bool brace = members[i].Role != null && members[i].Role.StartsWith("brace");
            if (brace) braceCount++;

            StockPiece piece = current.Assigned[i];
            SectionProfile profile = piece != null
                ? SectionProfile.Parse(piece.Section, inch)
                : null;
            Mesh mesh = MemberMesh.Build(members[i].A, members[i].B, profile);
            if (mesh == null) continue;
            meshes.Add(mesh);
            meshed++;
            if (piece != null)
            {
                if (brace) _meshBrace.Add(mesh);
                else _meshMatched.Add(mesh);
            }
            else _meshUnmatched.Add(mesh);
        }

        Truss = meshes;
        ReuseRatio = current.ReuseRatio;
        Variation = opt.ObjectiveScore - current.ObjectiveScore;

        Print("{0}  |  frames {1}  |  panels {2} (optimized {3})  |  members {4} ({5} braces)", kind, frames.Count, nUse, nOpt, members.Count, braceCount);
        Print("weights  reuse {0:0.##}  fit {1:0.##}  cost/location {2:0.##}  energy {3:0.##}", weights.Reuse, weights.Fit, weights.Cost, weights.Energy);
        Print("reuse {0:0.0%}  |  fit {1:0.0%}  |  objective {2:0.000} (opt {3:0.000})  |  variation {4:0.000}",
            current.ReuseRatio, current.FitRatio, current.ObjectiveScore, opt.ObjectiveScore, (double)Variation);
        Print("matched {0}/{1} from Source A HSS ({2} reusable pieces)", current.MatchCount, members.Count, stock.Count);
        Print("meshes {0} with true HSS / W sections (inches → meters)", meshed);
        Print(current.Summary);
        Print("cost £{0:0.00}  (material £{1:0.00} + transport £{2:0.00})  |  trips A={3} B={4}  |  haul {5:0.1} t·km",
            current.TotalCostGbp, current.MaterialCostGbp, current.TransportCostGbp,
            current.TripsA, current.TripsB, current.TonneKm);
        Print("energy saved ~{0:0} kgCO2e  |  {1}  |  {2}", current.CarbonSaved, current.ScenarioId, dataFolder);
    }

    public override void DrawViewportWires(IGH_PreviewArgs args)
    {
        if (_chords == null) return;
        for (int i = 0; i < _chords.Count; i++)
            args.Display.DrawCurve(_chords[i], Color.FromArgb(180, 180, 190), 1);
    }

    public override void DrawViewportMeshes(IGH_PreviewArgs args)
    {
        DrawMeshes(args, _meshMatched, Color.FromArgb(56, 152, 88));
        DrawMeshes(args, _meshBrace, Color.FromArgb(48, 96, 200));
        DrawMeshes(args, _meshUnmatched, Color.FromArgb(196, 48, 48));
    }

    static void DrawMeshes(IGH_PreviewArgs args, List<Mesh> meshes, Color color)
    {
        if (meshes == null) return;
        var mat = new DisplayMaterial(color);
        mat.Transparency = 0.15;
        for (int i = 0; i < meshes.Count; i++)
        {
            if (meshes[i] == null || !meshes[i].IsValid) continue;
            args.Display.DrawMeshShaded(meshes[i], mat);
            args.Display.DrawMeshWires(meshes[i], Color.FromArgb(80, color.R, color.G, color.B));
        }
    }

    private string FindCostFolder(out string used)
    {
        var candidates = new List<string>();
        candidates.Add(@"C:\Users\pdanahy3\Downloads\IASS-2026-Workshop_SecondLives\steel_cost_dataset_package");
        if (GrasshopperDocument != null && !string.IsNullOrEmpty(GrasshopperDocument.FilePath))
        {
            string root = Path.GetDirectoryName(GrasshopperDocument.FilePath);
            candidates.Add(Path.GetFullPath(Path.Combine(root, @"..\steel_cost_dataset_package")));
            candidates.Add(Path.GetFullPath(Path.Combine(root, @"steel_cost_dataset_package")));
        }
        for (int i = 0; i < candidates.Count; i++)
        {
            if (File.Exists(Path.Combine(candidates[i], "harmonized_source_A_gsr_reno_hss_with_cost.csv")))
            {
                used = candidates[i];
                return used;
            }
        }
        used = candidates[0];
        return used;
    }

    private class StockPiece
    {
        public string Id;
        public string Section;
        public double Length;
        public double Mass;
        public double Carbon;
        public string DepotId;
        public double DistanceKm;
        public double MaterialCostGbp;
        public double PricePerKg;
        public StockPiece Clone()
        {
            return new StockPiece
            {
                Id = Id,
                Section = Section,
                Length = Length,
                Mass = Mass,
                Carbon = Carbon,
                DepotId = DepotId,
                DistanceKm = DistanceKm,
                MaterialCostGbp = MaterialCostGbp,
                PricePerKg = PricePerKg
            };
        }
    }

    private class Weights
    {
        public double Reuse;
        public double Fit;
        public double Cost;
        public double Energy;

        public double Sum
        {
            get { return Reuse + Fit + Cost + Energy; }
        }

        public static Weights From(double reuse, double fit, double cost, double energy)
        {
            reuse = Clamp(reuse);
            fit = Clamp(fit);
            cost = Clamp(cost);
            energy = Clamp(energy);
            if (reuse + fit + cost + energy < 1e-9)
            {
                reuse = 1.0;
                fit = 1.0;
                cost = 1.0;
                energy = 1.0;
            }
            return new Weights { Reuse = reuse, Fit = fit, Cost = cost, Energy = energy };
        }

        static double Clamp(double v)
        {
            if (double.IsNaN(v) || double.IsInfinity(v) || v < 0.0) return 0.0;
            return v;
        }
    }

    private class Member
    {
        public Point3d A;
        public Point3d B;
        public string Role;
        public double Length { get { return A.DistanceTo(B); } }
    }

    private class SectionProfile
    {
        public string Kind; // box, cyl, wshape
        public double Width;
        public double Depth;
        public double Thickness;
        public double FlangeT;
        public double WebT;

        public static SectionProfile Parse(string section, double inch)
        {
            if (string.IsNullOrEmpty(section)) return Default(inch);
            string upper = section.Trim().ToUpperInvariant().Replace(" ", "");

            if (upper.StartsWith("HSS"))
            {
                string[] parts = upper.Substring(3).Split('X');
                var nums = new List<double>();
                for (int i = 0; i < parts.Length; i++)
                {
                    double v;
                    if (!TryFrac(parts[i], out v)) return Default(inch);
                    nums.Add(v);
                }
                if (nums.Count == 3)
                {
                    return new SectionProfile
                    {
                        Kind = "box",
                        Depth = nums[0] * inch,
                        Width = nums[1] * inch,
                        Thickness = nums[2] * inch
                    };
                }
                if (nums.Count == 2)
                {
                    return new SectionProfile
                    {
                        Kind = "cyl",
                        Depth = nums[0] * inch,
                        Width = nums[0] * inch,
                        Thickness = nums[1] * inch
                    };
                }
                return Default(inch);
            }

            if (upper == "W6X12") return WShape(6.03, 4.00, 0.280, 0.230, inch);
            if (upper == "W8X31") return WShape(8.00, 8.00, 0.435, 0.285, inch);
            if (upper == "W8X40") return WShape(8.25, 8.07, 0.560, 0.360, inch);
            if (upper == "W14X159") return WShape(14.98, 15.565, 1.190, 0.745, inch);
            return Default(inch);
        }

        static SectionProfile WShape(double depth, double flange, double ft, double wt, double inch)
        {
            return new SectionProfile
            {
                Kind = "wshape",
                Depth = depth * inch,
                Width = flange * inch,
                FlangeT = ft * inch,
                WebT = wt * inch
            };
        }

        static SectionProfile Default(double inch)
        {
            return new SectionProfile
            {
                Kind = "box",
                Depth = 4.0 * inch,
                Width = 4.0 * inch,
                Thickness = 0.375 * inch
            };
        }

        static bool TryFrac(string text, out double value)
        {
            value = 0.0;
            if (string.IsNullOrEmpty(text)) return false;
            int slash = text.IndexOf('/');
            if (slash > 0)
            {
                double num, den;
                if (double.TryParse(text.Substring(0, slash), NumberStyles.Float, CultureInfo.InvariantCulture, out num)
                    && double.TryParse(text.Substring(slash + 1), NumberStyles.Float, CultureInfo.InvariantCulture, out den)
                    && den != 0.0)
                {
                    value = num / den;
                    return true;
                }
                return false;
            }
            return double.TryParse(text, NumberStyles.Float, CultureInfo.InvariantCulture, out value);
        }
    }

    private class MemberMesh
    {
        public static Mesh Build(Point3d a, Point3d b, SectionProfile profile)
        {
            Vector3d x, y, z;
            if (!Frame(a, b, out x, out y, out z)) return null;
            if (profile == null) profile = SectionProfile.Parse(null, 0.0254);

            double len = a.DistanceTo(b);
            Mesh mesh;
            if (profile.Kind == "cyl") mesh = HollowCylinder(len, profile.Width * 0.5, profile.Thickness);
            else if (profile.Kind == "wshape") mesh = WShape(len, profile.Width, profile.Depth, profile.FlangeT, profile.WebT);
            else mesh = HollowBox(len, profile.Width, profile.Depth, profile.Thickness);

            if (mesh == null) return null;
            mesh.Transform(Transform.PlaneToPlane(Plane.WorldXY, new Plane(a, x, y)));
            mesh.Normals.ComputeNormals();
            mesh.Compact();
            mesh.FaceNormals.ComputeFaceNormals();
            return mesh;
        }

        static bool Frame(Point3d a, Point3d b, out Vector3d x, out Vector3d y, out Vector3d z)
        {
            x = b - a;
            y = Vector3d.Zero;
            z = Vector3d.Zero;
            if (!x.Unitize()) return false;
            z = Vector3d.ZAxis;
            z = z - x * (z * x);
            if (z.IsTiny())
            {
                z = Vector3d.YAxis;
                z = z - x * (z * x);
            }
            if (!z.Unitize()) return false;
            y = Vector3d.CrossProduct(z, x);
            if (!y.Unitize()) return false;
            z = Vector3d.CrossProduct(x, y);
            z.Unitize();
            return true;
        }

        static Mesh HollowBox(double length, double width, double depth, double t)
        {
            double hy = width * 0.5;
            double hz = depth * 0.5;
            if (t <= 0.0 || t * 2.0 >= Math.Min(width, depth))
                return Box(0.0, length, -hy, hy, -hz, hz);

            var mesh = new Mesh();
            AppendBox(mesh, 0.0, length, -hy, hy, -hz, -hz + t);
            AppendBox(mesh, 0.0, length, -hy, hy, hz - t, hz);
            AppendBox(mesh, 0.0, length, -hy, -hy + t, -hz + t, hz - t);
            AppendBox(mesh, 0.0, length, hy - t, hy, -hz + t, hz - t);
            return mesh;
        }

        static Mesh WShape(double length, double width, double depth, double flangeT, double webT)
        {
            double hy = width * 0.5;
            double hz = depth * 0.5;
            double hw = webT * 0.5;
            var mesh = new Mesh();
            AppendBox(mesh, 0.0, length, -hy, hy, -hz, -hz + flangeT);
            AppendBox(mesh, 0.0, length, -hy, hy, hz - flangeT, hz);
            AppendBox(mesh, 0.0, length, -hw, hw, -hz + flangeT, hz - flangeT);
            return mesh;
        }

        static Mesh Box(double x0, double x1, double y0, double y1, double z0, double z1)
        {
            var mesh = new Mesh();
            AppendBox(mesh, x0, x1, y0, y1, z0, z1);
            return mesh;
        }

        static void AppendBox(Mesh mesh, double x0, double x1, double y0, double y1, double z0, double z1)
        {
            int i = mesh.Vertices.Count;
            mesh.Vertices.Add(x0, y0, z0);
            mesh.Vertices.Add(x0, y1, z0);
            mesh.Vertices.Add(x0, y1, z1);
            mesh.Vertices.Add(x0, y0, z1);
            mesh.Vertices.Add(x1, y0, z0);
            mesh.Vertices.Add(x1, y1, z0);
            mesh.Vertices.Add(x1, y1, z1);
            mesh.Vertices.Add(x1, y0, z1);
            mesh.Faces.AddFace(i + 0, i + 1, i + 2, i + 3);
            mesh.Faces.AddFace(i + 7, i + 6, i + 5, i + 4);
            mesh.Faces.AddFace(i + 0, i + 4, i + 5, i + 1);
            mesh.Faces.AddFace(i + 3, i + 2, i + 6, i + 7);
            mesh.Faces.AddFace(i + 0, i + 3, i + 7, i + 4);
            mesh.Faces.AddFace(i + 1, i + 5, i + 6, i + 2);
        }

        static Mesh HollowCylinder(double length, double outerR, double t)
        {
            int sides = 12;
            double innerR = Math.Max(outerR - t, outerR * 0.15);
            var mesh = new Mesh();
            for (int end = 0; end < 2; end++)
            {
                double x = end == 0 ? 0.0 : length;
                for (int k = 0; k < sides; k++)
                {
                    double ang = 2.0 * Math.PI * k / sides;
                    mesh.Vertices.Add(x, outerR * Math.Cos(ang), outerR * Math.Sin(ang));
                }
            }
            for (int end = 0; end < 2; end++)
            {
                double x = end == 0 ? 0.0 : length;
                for (int k = 0; k < sides; k++)
                {
                    double ang = 2.0 * Math.PI * k / sides;
                    mesh.Vertices.Add(x, innerR * Math.Cos(ang), innerR * Math.Sin(ang));
                }
            }
            int o0 = 0;
            int o1 = sides;
            int i0 = sides * 2;
            int i1 = sides * 3;
            for (int k = 0; k < sides; k++)
            {
                int n = (k + 1) % sides;
                mesh.Faces.AddFace(o0 + k, o0 + n, o1 + n, o1 + k);
                mesh.Faces.AddFace(i0 + n, i0 + k, i1 + k, i1 + n);
                mesh.Faces.AddFace(o0 + k, i0 + k, i0 + n, o0 + n);
                mesh.Faces.AddFace(o1 + n, i1 + n, i1 + k, o1 + k);
            }
            return mesh;
        }
    }

    private class ChordPair
    {
        public Curve Bottom;
        public Curve Top;
        public double Span { get { return Bottom.GetLength(); } }

        public static List<ChordPair> FromEachCurve(List<Curve> curves, RhinoDoc doc)
        {
            double span = 0.0;
            for (int i = 0; i < curves.Count; i++) span += curves[i].GetLength();
            span /= Math.Max(curves.Count, 1);
            double depth = Math.Max(span / 12.0, 1.5);
            depth = Math.Min(depth, span / 6.0);

            var frames = new List<ChordPair>();
            for (int i = 0; i < curves.Count; i++)
                frames.Add(FromCurve(curves[i], depth));
            return frames;
        }

        public static ChordPair FromCurve(Curve bottom, double depth)
        {
            Curve top = bottom.DuplicateCurve();
            top.Translate(0.0, 0.0, depth);
            return new ChordPair { Bottom = bottom, Top = top };
        }
    }

    private class FrameLayout
    {
        public static List<Curve> OrderAndAlign(List<Curve> curves)
        {
            var ordered = new List<Curve>(curves);
            if (ordered.Count < 2) return ordered;

            Vector3d span = Vector3d.Zero;
            Point3d origin = Point3d.Origin;
            for (int i = 0; i < ordered.Count; i++)
            {
                Vector3d d = ordered[i].PointAtEnd - ordered[i].PointAtStart;
                if (!d.IsTiny()) { d.Unitize(); span += d; }
                origin += ordered[i].GetBoundingBox(true).Center;
            }
            origin /= ordered.Count;
            if (span.IsTiny()) span = Vector3d.XAxis;
            else span.Unitize();

            Vector3d side = Vector3d.CrossProduct(span, Vector3d.ZAxis);
            if (side.IsTiny()) side = Vector3d.CrossProduct(span, Vector3d.YAxis);
            side.Unitize();

            ordered.Sort(delegate (Curve a, Curve b)
            {
                double ta = (a.GetBoundingBox(true).Center - origin) * side;
                double tb = (b.GetBoundingBox(true).Center - origin) * side;
                return ta.CompareTo(tb);
            });

            Vector3d first = ordered[0].PointAtEnd - ordered[0].PointAtStart;
            for (int i = 0; i < ordered.Count; i++)
            {
                Vector3d d = ordered[i].PointAtEnd - ordered[i].PointAtStart;
                if (d * first < 0.0) ordered[i].Reverse();
            }
            return ordered;
        }
    }

    private class BuiltTruss
    {
        public List<Member> Members = new List<Member>();
        public Point3d[] Bottom;
        public Point3d[] Top;
    }

    private class Depot
    {
        public string Id;
        public string Prefix;
        public double DistanceKm;
        public double TripCostGbp;
    }

    private class CostParams
    {
        public string ScenarioId = "synthetic_base_v1";
        public double TruckPayloadT = 24.0;
        public double TripFixedGbp = 250.0;
        public double VehicleGbpPerKm = 1.5;
        public double RoundTrip = 2.0;
        public double MaxTransportLengthM = 13.6;
        public double PricePerKg = 0.6;
    }

    private class Inventory
    {
        static List<StockPiece> _cache;
        static string _cachePath;
        public static CostParams Params = new CostParams();
        public static Dictionary<string, Depot> Depots = new Dictionary<string, Depot>();

        public static List<StockPiece> Load(string folder)
        {
            if (_cache != null && _cachePath == folder) return Clone(_cache);
            Params = LoadParams(Path.Combine(folder, "cost_parameters.csv"));
            Depots = LoadDepots(Path.Combine(folder, "depots.csv"));
            string inv = Path.Combine(folder, "harmonized_source_A_gsr_reno_hss_with_cost.csv");
            var list = LoadStock(inv);
            _cache = list;
            _cachePath = folder;
            return Clone(list);
        }

        static CostParams LoadParams(string path)
        {
            var p = new CostParams();
            if (!File.Exists(path)) return p;
            string[] lines = File.ReadAllLines(path, Encoding.UTF8);
            for (int i = 1; i < lines.Length; i++)
            {
                if (string.IsNullOrWhiteSpace(lines[i])) continue;
                string[] c = SplitCsv(lines[i]);
                if (c.Length < 2) continue;
                string key = c[0].Trim();
                string val = c[1].Trim();
                if (key == "cost_scenario_id") p.ScenarioId = val;
                else if (key == "reuse_price_gbp_per_kg") p.PricePerKg = Parse(val);
                else if (key == "truck_payload_t") p.TruckPayloadT = Parse(val);
                else if (key == "trip_fixed_cost_gbp") p.TripFixedGbp = Parse(val);
                else if (key == "vehicle_cost_gbp_per_km") p.VehicleGbpPerKm = Parse(val);
                else if (key == "round_trip_multiplier") p.RoundTrip = Parse(val);
                else if (key == "max_transport_length_m") p.MaxTransportLengthM = Parse(val);
            }
            return p;
        }

        static Dictionary<string, Depot> LoadDepots(string path)
        {
            var map = new Dictionary<string, Depot>(StringComparer.OrdinalIgnoreCase);
            if (!File.Exists(path)) return map;
            string[] lines = File.ReadAllLines(path, Encoding.UTF8);
            var col = Header(lines.Length > 0 ? lines[0] : "");
            for (int i = 1; i < lines.Length; i++)
            {
                if (string.IsNullOrWhiteSpace(lines[i])) continue;
                string[] c = SplitCsv(lines[i]);
                var d = new Depot
                {
                    Id = Cell(c, col, "depot_id"),
                    Prefix = Cell(c, col, "element_id_prefix"),
                    DistanceKm = Parse(Cell(c, col, "distance_to_site_km")),
                    TripCostGbp = Parse(Cell(c, col, "depot_trip_cost_gbp"))
                };
                if (string.IsNullOrEmpty(d.Id)) continue;
                if (d.TripCostGbp <= 0.0)
                    d.TripCostGbp = Params.TripFixedGbp + Params.RoundTrip * d.DistanceKm * Params.VehicleGbpPerKm;
                map[d.Id] = d;
            }
            return map;
        }

        static List<StockPiece> LoadStock(string path)
        {
            var list = new List<StockPiece>();
            if (!File.Exists(path)) return list;
            string[] lines = File.ReadAllLines(path, Encoding.UTF8);
            var col = Header(lines.Length > 0 ? lines[0] : "");
            for (int i = 1; i < lines.Length; i++)
            {
                if (string.IsNullOrWhiteSpace(lines[i])) continue;
                string[] c = SplitCsv(lines[i]);
                if (Parse(Cell(c, col, "is_reuse_candidate")) < 0.5) continue;
                if (Parse(Cell(c, col, "standard_transport_eligible")) < 0.5) continue;
                double reusableFt = Parse(Cell(c, col, "reusable_length_ft"));
                double lengthM = Parse(Cell(c, col, "length_m"));
                if (reusableFt <= 0.0) continue;
                if (lengthM > Params.MaxTransportLengthM + 1e-9) continue;

                string depotId = Cell(c, col, "depot_id");
                double distance = Parse(Cell(c, col, "distance_to_site_km"));
                Depot depot;
                if (Depots.TryGetValue(depotId, out depot))
                    distance = depot.DistanceKm;

                list.Add(new StockPiece
                {
                    Id = Cell(c, col, "element_id"),
                    Section = Cell(c, col, "section_or_species"),
                    Length = reusableFt * 0.3048,
                    Mass = Parse(Cell(c, col, "mass_kg")),
                    Carbon = Parse(Cell(c, col, "embodied_carbon_savings_kgco2e")),
                    DepotId = depotId,
                    DistanceKm = distance,
                    MaterialCostGbp = Parse(Cell(c, col, "reusable_material_cost_gbp")),
                    PricePerKg = Parse(Cell(c, col, "reuse_price_gbp_per_kg"))
                });
            }
            return list;
        }

        static Dictionary<string, int> Header(string line)
        {
            if (line.Length > 0 && line[0] == '\ufeff') line = line.Substring(1);
            string[] c = SplitCsv(line);
            var map = new Dictionary<string, int>(StringComparer.OrdinalIgnoreCase);
            for (int i = 0; i < c.Length; i++)
            {
                string name = c[i].Trim();
                if (!map.ContainsKey(name)) map[name] = i;
            }
            return map;
        }

        static string Cell(string[] row, Dictionary<string, int> col, string name)
        {
            int i;
            if (!col.TryGetValue(name, out i) || i < 0 || i >= row.Length) return "";
            return row[i].Trim();
        }

        static string[] SplitCsv(string line)
        {
            var cells = new List<string>();
            var sb = new StringBuilder();
            bool quoted = false;
            for (int i = 0; i < line.Length; i++)
            {
                char ch = line[i];
                if (ch == '"')
                {
                    if (quoted && i + 1 < line.Length && line[i + 1] == '"')
                    {
                        sb.Append('"');
                        i++;
                    }
                    else quoted = !quoted;
                }
                else if (ch == ',' && !quoted)
                {
                    cells.Add(sb.ToString());
                    sb.Length = 0;
                }
                else sb.Append(ch);
            }
            cells.Add(sb.ToString());
            return cells.ToArray();
        }

        static List<StockPiece> Clone(List<StockPiece> src)
        {
            var copy = new List<StockPiece>(src.Count);
            for (int i = 0; i < src.Count; i++) copy.Add(src[i].Clone());
            return copy;
        }

        static double Parse(string text)
        {
            if (string.IsNullOrEmpty(text)) return 0.0;
            double v;
            if (double.TryParse(text.Trim(), NumberStyles.Float, CultureInfo.InvariantCulture, out v)) return v;
            return 0.0;
        }
    }

    private class TrussBuilder
    {
        public static string NormalizeType(string raw)
        {
            if (string.IsNullOrEmpty(raw)) return "Warren";
            string s = raw.Trim().ToLowerInvariant();
            if (s.Contains("pratt")) return "Pratt";
            if (s.Contains("howe")) return "Howe";
            if (s.Contains("fink") || s.Contains("fan") || s.Contains("w-")) return "Fink";
            return "Warren";
        }

        public static int ClampPanels(string kind, int n)
        {
            if (n < 4) n = 4;
            if (n > 16) n = 16;
            if (kind == "Fink" && n % 2 != 0) n += 1;
            if (n > 16) n = 16;
            if (kind == "Fink" && n < 4) n = 4;
            return n;
        }

        public static int BestPanelCount(string kind, List<ChordPair> frames, List<StockPiece> stock, Weights weights)
        {
            int step = kind == "Fink" ? 2 : 1;
            var trials = new List<AssignResult>();
            var ns = new List<int>();
            for (int n = 4; n <= 16; n += step)
            {
                List<Member> members = BuildSystem(kind, frames, n);
                if (members.Count == 0) continue;
                ns.Add(n);
                trials.Add(Assigner.BestFit(members, stock, weights));
            }
            if (trials.Count == 0) return 8;

            double minR = trials[0].ReuseRatio, maxR = minR;
            double minF = trials[0].FitRatio, maxF = minF;
            double minC = trials[0].TotalCostGbp, maxC = minC;
            double minE = trials[0].CarbonSaved, maxE = minE;
            double minT = trials[0].TonneKm, maxT = minT;
            for (int i = 1; i < trials.Count; i++)
            {
                if (trials[i].ReuseRatio < minR) minR = trials[i].ReuseRatio;
                if (trials[i].ReuseRatio > maxR) maxR = trials[i].ReuseRatio;
                if (trials[i].FitRatio < minF) minF = trials[i].FitRatio;
                if (trials[i].FitRatio > maxF) maxF = trials[i].FitRatio;
                if (trials[i].TotalCostGbp < minC) minC = trials[i].TotalCostGbp;
                if (trials[i].TotalCostGbp > maxC) maxC = trials[i].TotalCostGbp;
                if (trials[i].CarbonSaved < minE) minE = trials[i].CarbonSaved;
                if (trials[i].CarbonSaved > maxE) maxE = trials[i].CarbonSaved;
                if (trials[i].TonneKm < minT) minT = trials[i].TonneKm;
                if (trials[i].TonneKm > maxT) maxT = trials[i].TonneKm;
            }

            int bestN = ns[0];
            double best = -1.0;
            for (int i = 0; i < trials.Count; i++)
            {
                double score = Assigner.Objective(trials[i], weights, minR, maxR, minF, maxF, minC, maxC, minE, maxE, minT, maxT);
                trials[i].ObjectiveScore = score;
                if (score > best + 1e-9 || (Math.Abs(score - best) < 1e-9 && ns[i] == 8))
                {
                    best = score;
                    bestN = ns[i];
                }
            }
            return bestN;
        }

        public static List<Member> BuildSystem(string kind, List<ChordPair> frames, int n)
        {
            n = ClampPanels(kind, n);
            var built = new List<BuiltTruss>();
            var all = new List<Member>();
            for (int i = 0; i < frames.Count; i++)
            {
                BuiltTruss frame = BuildFrame(kind, frames[i], n);
                built.Add(frame);
                all.AddRange(frame.Members);
            }
            for (int i = 0; i < built.Count - 1; i++)
                all.AddRange(BraceBetween(built[i], built[i + 1], kind));
            return all;
        }

        public static BuiltTruss BuildFrame(string kind, ChordPair chords, int n)
        {
            n = ClampPanels(kind, n);
            if (kind == "Warren") return Warren(chords, n);
            if (kind == "Pratt") return Pratt(chords, n, false);
            if (kind == "Howe") return Pratt(chords, n, true);
            return Fink(chords, n);
        }

        public static List<Member> BraceBetween(BuiltTruss a, BuiltTruss b, string kind)
        {
            var m = new List<Member>();
            double min = 1.0;
            if (a.Bottom != null && a.Bottom.Length > 1)
                min = Math.Max(a.Bottom[0].DistanceTo(a.Bottom[1]) * 1e-3, 1.0);

            Laterals(m, a.Bottom, b.Bottom, "brace_bottom", min);
            Laterals(m, a.Top, b.Top, "brace_top", min);

            bool everyBay = kind == "Fink" || kind == "Warren";
            PlanX(m, a.Bottom, b.Bottom, "brace_web", min, everyBay);
            PlanX(m, a.Top, b.Top, "brace_web", min, everyBay);

            Portal(m, a, b, min);
            return m;
        }

        static void Laterals(List<Member> m, Point3d[] a, Point3d[] b, string role, double min)
        {
            if (a == null || b == null) return;
            int n = Math.Min(a.Length, b.Length);
            for (int i = 0; i < n; i++) Add(m, Seg(a[i], b[i], role, min));
        }

        static void PlanX(List<Member> m, Point3d[] a, Point3d[] b, string role, double min, bool everyBay)
        {
            if (a == null || b == null) return;
            int n = Math.Min(a.Length, b.Length);
            for (int i = 0; i < n - 1; i++)
            {
                if (!everyBay && i % 2 != 0) continue;
                Add(m, Seg(a[i], b[i + 1], role, min));
                Add(m, Seg(a[i + 1], b[i], role, min));
            }
        }

        static void Portal(List<Member> m, BuiltTruss a, BuiltTruss b, double min)
        {
            if (a.Bottom == null || b.Bottom == null || a.Top == null || b.Top == null) return;
            Add(m, Seg(a.Bottom[0], b.Top[0], "brace_web", min));
            Add(m, Seg(a.Top[0], b.Bottom[0], "brace_web", min));
            int ib = a.Bottom.Length - 1;
            int jb = b.Bottom.Length - 1;
            int it = a.Top.Length - 1;
            int jt = b.Top.Length - 1;
            Add(m, Seg(a.Bottom[ib], b.Top[jt], "brace_web", min));
            Add(m, Seg(a.Top[it], b.Bottom[jb], "brace_web", min));
        }

        static Point3d On(Curve c, double t)
        {
            return c.PointAtNormalizedLength(Math.Min(1.0, Math.Max(0.0, t)));
        }

        static Member Seg(Point3d a, Point3d b, string role, double minLen)
        {
            if (a.DistanceTo(b) < minLen) return null;
            return new Member { A = a, B = b, Role = role };
        }

        static void Add(List<Member> list, Member m)
        {
            if (m != null) list.Add(m);
        }

        static double MinLen(ChordPair chords)
        {
            return Math.Max(chords.Span * 1e-4, 1.0);
        }

        static BuiltTruss Warren(ChordPair chords, int n)
        {
            var built = new BuiltTruss();
            double min = MinLen(chords);
            var B = new Point3d[n + 1];
            var T = new Point3d[n];
            for (int i = 0; i <= n; i++) B[i] = On(chords.Bottom, (double)i / n);
            for (int i = 0; i < n; i++) T[i] = On(chords.Top, (i + 0.5) / n);
            for (int i = 0; i < n; i++) Add(built.Members, Seg(B[i], B[i + 1], "bottom_chord", min));
            for (int i = 0; i < n - 1; i++) Add(built.Members, Seg(T[i], T[i + 1], "top_chord", min));
            for (int i = 0; i < n; i++)
            {
                Add(built.Members, Seg(B[i], T[i], "diagonal", min));
                Add(built.Members, Seg(T[i], B[i + 1], "diagonal", min));
            }
            built.Bottom = B;
            built.Top = T;
            return built;
        }

        static BuiltTruss Pratt(ChordPair chords, int n, bool howe)
        {
            var built = new BuiltTruss();
            double min = MinLen(chords);
            var B = new Point3d[n + 1];
            var T = new Point3d[n + 1];
            for (int i = 0; i <= n; i++)
            {
                double t = (double)i / n;
                B[i] = On(chords.Bottom, t);
                T[i] = On(chords.Top, t);
            }
            for (int i = 0; i < n; i++)
            {
                Add(built.Members, Seg(B[i], B[i + 1], "bottom_chord", min));
                Add(built.Members, Seg(T[i], T[i + 1], "top_chord", min));
            }
            for (int i = 0; i <= n; i++) Add(built.Members, Seg(B[i], T[i], "vertical", min));

            int mid = n / 2;
            for (int i = 0; i < n; i++)
            {
                Point3d a, b;
                if (!howe)
                {
                    if (i < mid) { a = T[i]; b = B[i + 1]; }
                    else { a = T[i + 1]; b = B[i]; }
                }
                else
                {
                    if (i < mid) { a = B[i]; b = T[i + 1]; }
                    else { a = B[i + 1]; b = T[i]; }
                }
                Add(built.Members, Seg(a, b, "diagonal", min));
            }
            built.Bottom = B;
            built.Top = T;
            return built;
        }

        static BuiltTruss Fink(ChordPair chords, int n)
        {
            if (n % 2 != 0) n += 1;
            var built = new BuiltTruss();
            double min = MinLen(chords);
            var B = new Point3d[n + 1];
            var T = new Point3d[n + 1];
            for (int i = 0; i <= n; i++)
            {
                double t = (double)i / n;
                B[i] = On(chords.Bottom, t);
                T[i] = On(chords.Top, t);
            }
            for (int i = 0; i < n; i++)
            {
                Add(built.Members, Seg(B[i], B[i + 1], "bottom_chord", min));
                Add(built.Members, Seg(T[i], T[i + 1], "top_chord", min));
            }
            Add(built.Members, Seg(B[0], T[0], "vertical", min));
            Add(built.Members, Seg(B[n], T[n], "vertical", min));
            Add(built.Members, Seg(B[n / 2], T[n / 2], "vertical", min));
            for (int i = 0; i < n; i += 2)
            {
                Add(built.Members, Seg(T[i], B[i + 1], "diagonal", min));
                Add(built.Members, Seg(B[i + 1], T[i + 2], "diagonal", min));
                Add(built.Members, Seg(B[i], T[i + 1], "diagonal", min));
                Add(built.Members, Seg(T[i + 1], B[i + 2], "diagonal", min));
                if (i + 1 != n / 2) Add(built.Members, Seg(B[i + 1], T[i + 1], "vertical", min));
            }
            built.Bottom = B;
            built.Top = T;
            return built;
        }
    }

    private class AssignResult
    {
        public StockPiece[] Assigned;
        public int MatchCount;
        public double ReuseRatio;
        public string Summary;
        public string ScenarioId;
        public double MaterialCostGbp;
        public double TransportCostGbp;
        public double TotalCostGbp;
        public int TripsA;
        public int TripsB;
        public double FitRatio;
        public double CarbonSaved;
        public double TonneKm;
        public double ObjectiveScore;
    }

    private class Assigner
    {
        public static AssignResult BestFit(List<Member> members, List<StockPiece> stock, Weights weights)
        {
            return Match(members, stock, null, weights);
        }

        public static AssignResult Seeded(List<Member> members, List<StockPiece> stock, int seed, Weights weights)
        {
            var rng = new Random(seed);
            var shuffled = new List<StockPiece>(stock.Count);
            for (int i = 0; i < stock.Count; i++) shuffled.Add(stock[i].Clone());
            for (int i = shuffled.Count - 1; i > 0; i--)
            {
                int j = rng.Next(i + 1);
                StockPiece tmp = shuffled[i];
                shuffled[i] = shuffled[j];
                shuffled[j] = tmp;
            }
            return Match(members, shuffled, rng, weights);
        }

        public static double Objective(AssignResult r, Weights w,
            double minR, double maxR, double minF, double maxF,
            double minC, double maxC, double minE, double maxE, double minT, double maxT)
        {
            double reuse = Norm(r.ReuseRatio, minR, maxR);
            double fit = Norm(r.FitRatio, minF, maxF);
            double cost = 1.0 - Norm(r.TotalCostGbp, minC, maxC);
            double carbon = Norm(r.CarbonSaved, minE, maxE);
            double haul = 1.0 - Norm(r.TonneKm, minT, maxT);
            double energy = 0.6 * carbon + 0.4 * haul;
            double sum = Math.Max(w.Sum, 1e-9);
            return (w.Reuse * reuse + w.Fit * fit + w.Cost * cost + w.Energy * energy) / sum;
        }

        static double Norm(double v, double min, double max)
        {
            if (max - min < 1e-9) return 1.0;
            return (v - min) / (max - min);
        }

        static AssignResult Match(List<Member> members, List<StockPiece> stock, Random rng, Weights weights)
        {
            var available = new List<StockPiece>(stock.Count);
            for (int i = 0; i < stock.Count; i++) available.Add(stock[i].Clone());

            var order = new int[members.Count];
            for (int i = 0; i < order.Length; i++) order[i] = i;
            Array.Sort(order, delegate (int a, int b)
            {
                return members[b].Length.CompareTo(members[a].Length);
            });
            if (rng != null)
            {
                for (int i = order.Length - 1; i > 0; i--)
                {
                    int j = rng.Next(i + 1);
                    int tmp = order[i];
                    order[i] = order[j];
                    order[j] = tmp;
                }
            }

            var assigned = new StockPiece[members.Count];
            double matchedLen = 0.0;
            double consumed = 0.0;
            double carbon = 0.0;
            int matches = 0;

            for (int k = 0; k < order.Length; k++)
            {
                int i = order[k];
                double need = members[i].Length;
                int pick = -1;
                double bestScore = double.NegativeInfinity;
                for (int s = 0; s < available.Count; s++)
                {
                    if (available[s] == null) continue;
                    if (available[s].Length + 1e-9 < need) continue;
                    double score = PieceScore(available[s], need, weights);
                    if (rng != null) score *= 0.75 + 0.5 * rng.NextDouble();
                    if (pick < 0 || score > bestScore + 1e-12)
                    {
                        bestScore = score;
                        pick = s;
                    }
                }
                if (pick < 0) continue;
                assigned[i] = available[pick];
                matchedLen += need;
                consumed += available[pick].Length;
                carbon += available[pick].Carbon * (need / Math.Max(available[pick].Length, need));
                matches++;
                available[pick] = null;
            }

            double demand = 0.0;
            for (int i = 0; i < members.Count; i++) demand += members[i].Length;
            double unmatched = demand - matchedLen;
            double denom = consumed + unmatched;
            double ratio = denom <= 1e-9 ? 0.0 : matchedLen / denom;

            var roles = new Dictionary<string, int>();
            for (int i = 0; i < members.Count; i++)
            {
                string role = members[i].Role;
                if (!roles.ContainsKey(role)) roles[role] = 0;
                roles[role]++;
            }
            var sb = new StringBuilder();
            foreach (string key in new[] { "bottom_chord", "top_chord", "vertical", "diagonal", "brace_bottom", "brace_top", "brace_web" })
            {
                if (!roles.ContainsKey(key)) continue;
                sb.Append(key.Replace("_", " "));
                sb.Append(" ");
                sb.Append(roles[key]);
                sb.Append("  ");
            }
            sb.Append("saved ~");
            sb.Append(carbon.ToString("0", CultureInfo.InvariantCulture));
            sb.Append(" kgCO2e");

            double material = 0.0;
            double massA = 0.0;
            double massB = 0.0;
            double carbonSaved = 0.0;
            double tonneKm = 0.0;
            var seen = new Dictionary<string, bool>();
            for (int i = 0; i < assigned.Length; i++)
            {
                StockPiece piece = assigned[i];
                if (piece == null || string.IsNullOrEmpty(piece.Id)) continue;
                if (seen.ContainsKey(piece.Id)) continue;
                seen[piece.Id] = true;
                material += piece.MaterialCostGbp;
                carbonSaved += piece.Carbon;
                tonneKm += (piece.Mass / 1000.0) * piece.DistanceKm;
                if (string.Equals(piece.DepotId, "B", StringComparison.OrdinalIgnoreCase)) massB += piece.Mass;
                else massA += piece.Mass;
            }

            int tripsA = Trips(massA);
            int tripsB = Trips(massB);
            double transport = tripsA * TripCost("A") + tripsB * TripCost("B");
            double total = Math.Round(material + transport, 2);
            double fitRatio = consumed <= 1e-9 ? 0.0 : matchedLen / consumed;

            var result = new AssignResult
            {
                Assigned = assigned,
                MatchCount = matches,
                ReuseRatio = ratio,
                FitRatio = fitRatio,
                Summary = sb.ToString().Trim(),
                ScenarioId = Inventory.Params.ScenarioId,
                MaterialCostGbp = Math.Round(material, 2),
                TransportCostGbp = Math.Round(transport, 2),
                TotalCostGbp = total,
                TripsA = tripsA,
                TripsB = tripsB,
                CarbonSaved = carbonSaved,
                TonneKm = tonneKm
            };
            result.ObjectiveScore = Objective(result, weights, 0.0, 1.0, 0.0, 1.0, 0.0, Math.Max(total, 1.0), 0.0, Math.Max(carbonSaved, 1.0), 0.0, Math.Max(tonneKm, 1.0));
            return result;
        }

        static double PieceScore(StockPiece p, double need, Weights w)
        {
            double fit = need / Math.Max(p.Length, need);
            double loc = 1.0 - Math.Min(p.DistanceKm / 120.0, 1.0);
            double cheap = 1.0 / (1.0 + p.MaterialCostGbp / 400.0);
            double carbon = Math.Min(p.Carbon / Math.Max(p.Mass, 1.0) / 1.5, 1.0);
            double haul = loc;
            double energy = 0.6 * carbon + 0.4 * haul;
            double reuse = 1.0;
            double sum = Math.Max(w.Sum, 1e-9);
            return (w.Reuse * reuse + w.Fit * fit + w.Cost * (0.5 * loc + 0.5 * cheap) + w.Energy * energy) / sum;
        }

        static int Trips(double massKg)
        {
            if (massKg <= 1e-9) return 0;
            double cap = Math.Max(Inventory.Params.TruckPayloadT, 0.001) * 1000.0;
            return (int)Math.Ceiling(massKg / cap);
        }

        static double TripCost(string depotId)
        {
            Depot d;
            if (Inventory.Depots != null && Inventory.Depots.TryGetValue(depotId, out d) && d.TripCostGbp > 0.0)
                return d.TripCostGbp;
            CostParams p = Inventory.Params;
            double km = string.Equals(depotId, "B", StringComparison.OrdinalIgnoreCase) ? 120.0 : 30.0;
            return p.TripFixedGbp + p.RoundTrip * km * p.VehicleGbpPerKm;
        }
    }
}
# ---------- end c_script ----------
path = FilePath("C:\Users\pdanahy3\Downloads\IASS-2026-Workshop_SecondLives\wokshop-day\wokshop-day\data\harmonized_source_B_cambridge_pavilion.csv")  # disabled
path_2 = FilePath("C:\Users\pdanahy3\Downloads\IASS-2026-Workshop_SecondLives\wokshop-day\wokshop-day\data\harmonized_source_A_gsr_reno_hss.csv")  # disabled
panel = Panel(c_script.Variation)
panel_2 = Panel(c_script.ReuseRatio)
c_script_2 = CSharpScript(
    Span=number_slider_4,
    BuildingLength=number_slider_3,
    Height=number_slider_2,
    NumberOfBays=number_slider,
    ColumnSection=crosec,
    BeamSection=crosec,
    CsvPathA=path_2,
    CsvPathB=path)  # -> out, Columns, Beams, ReusedMembers, NewMembers, MatchingResults, ReusePercentage, NewSteelPercentage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; inputs Span: Double, BuildingLength: Double, Height: Double, NumberOfBays: Int32, ColumnSection: String, BeamSection: String, CsvPathA: String, CsvPathB: String; disabled
# ---------- c_script_2: C# ----------
using System;
using System.Collections.Generic;
using System.Globalization;
using System.IO;
using System.Linq;
using Grasshopper.Kernel;
using Rhino.Geometry;

public class Script_Instance : GH_ScriptInstance
{
  private const double FT_TO_M = 0.3048;

  private void RunScript(
		double Span,
		double BuildingLength,
		double Height,
		int NumberOfBays,
		string ColumnSection,
		string BeamSection,
		string CsvPathA,
		string CsvPathB,
		ref object Columns,
		ref object Beams,
		ref object ReusedMembers,
		ref object NewMembers,
		ref object MatchingResults,
		ref object ReusePercentage,
		ref object NewSteelPercentage,
		ref object UsedStock,
		ref object RemainingStock,
		ref object Report,
		ref object Debug)
  {
    List<string> debugLines = new List<string>();

    // ---------------------------------------------------------------
    // A. VALIDATE GEOMETRIC INPUTS
    // ---------------------------------------------------------------
    List<string> errors = new List<string>();
    if (Span <= 0) errors.Add("Span must be greater than 0.");
    if (Height <= 0) errors.Add("Height must be greater than 0.");
    if (BuildingLength <= 0) errors.Add("BuildingLength must be greater than 0.");
    if (NumberOfBays <= 0) errors.Add("NumberOfBays must be greater than 0.");
    if (string.IsNullOrWhiteSpace(ColumnSection)) errors.Add("ColumnSection is empty.");
    if (string.IsNullOrWhiteSpace(BeamSection)) errors.Add("BeamSection is empty.");

    if (errors.Count > 0)
    {
      foreach (string e in errors) AddRuntimeMessage(GH_RuntimeMessageLevel.Error, e);

      Columns = new List<Line>();
      Beams = new List<Line>();
      ReusedMembers = new List<Line>();
      NewMembers = new List<Line>();
      MatchingResults = new List<string>();
      ReusePercentage = 0.0;
      NewSteelPercentage = 0.0;
      UsedStock = new List<string>();
      RemainingStock = new List<string>();
      Report = "INVALID INPUT:\n" + string.Join("\n", errors);
      Debug = string.Join("\n", errors);
      return;
    }

    // ---------------------------------------------------------------
    // B. READ AND PARSE STOCK FROM THE TWO CSV FILES
    // A fresh copy is parsed from disk on every recompute, so nothing
    // from a previous solve carries over.
    // ---------------------------------------------------------------
    List<StockItem> stock = new List<StockItem>();
    stock.AddRange(ParseStockCsv(CsvPathA, debugLines));
    stock.AddRange(ParseStockCsv(CsvPathB, debugLines));

    if (stock.Count == 0)
      debugLines.Add("WARNING: no usable stock elements were loaded - all members will be NEW STEEL.");

    // ---------------------------------------------------------------
    // C. GENERATE BUILDING GEOMETRY
    // ---------------------------------------------------------------
    BuildingGeometry building = GenerateBuilding(Span, BuildingLength, Height, NumberOfBays);

    // ---------------------------------------------------------------
    // D. REQUIRED STRUCTURAL MEMBERS
    // ---------------------------------------------------------------
    List<Member> members = GenerateRequiredMembers(building, ColumnSection, BeamSection);

    // ---------------------------------------------------------------
    // E. MATCH MEMBERS TO STOCK
    // ---------------------------------------------------------------
    List<MatchResult> matchResults = MatchMembersToStock(members, stock);

    // ---------------------------------------------------------------
    // F. METRICS
    // ---------------------------------------------------------------
    Metrics metrics = CalculateMetrics(matchResults);

    // ---------------------------------------------------------------
    // G. OUTPUTS
    // ---------------------------------------------------------------
    Columns = members.Where(m => m.Type == "column").Select(m => m.Geometry).ToList();
    Beams = members.Where(m => m.Type == "beam").Select(m => m.Geometry).ToList();

    ReusedMembers = matchResults.Where(r => r.Status == "REUSED").Select(r => r.Member.Geometry).ToList();
    NewMembers = matchResults.Where(r => r.Status == "NEW STEEL").Select(r => r.Member.Geometry).ToList();

    MatchingResults = matchResults.Select(r => FormatMatchLine(r)).ToList();

    ReusePercentage = metrics.ReusePercentage;
    NewSteelPercentage = metrics.NewSteelPercentage;

    UsedStock = stock.Where(s => s.Used)
                      .Select(s => string.Format("{0},{1},{2:0.00} m -> {3}", s.Id, s.Section, s.Length, s.AssignedTo))
                      .ToList();

    RemainingStock = stock.Where(s => !s.Used)
                           .Select(s => string.Format("{0},{1},{2:0.00} m", s.Id, s.Section, s.Length))
                           .ToList();

    Report = GenerateReport(metrics, stock);

    debugLines.Insert(0, string.Format(
      "Required columns: {0} | Required beams: {1} | Total required members: {2}",
      members.Count(m => m.Type == "column"), members.Count(m => m.Type == "beam"), members.Count));
    debugLines.Insert(1, string.Format(
      "Matched members: {0} | Unmatched members: {1}", metrics.ReusedMembers, metrics.NewMembers));
    debugLines.Insert(2, string.Format("Total stock elements loaded: {0}", stock.Count));

    Debug = string.Join("\n", debugLines);
  }

  // ===================================================================
  // DATA STRUCTURES
  // ===================================================================

  private class StockItem
  {
    public string Id;
    public string Section;
    public double Length;   // meters, already converted from reusable_length_ft
    public bool Used;
    public string AssignedTo;
  }

  private class Member
  {
    public string Id;
    public string Type;     // "column" or "beam"
    public string Section;
    public double RequiredLength;
    public Curve Geometry;
  }

  private class MatchResult
  {
    public Member Member;
    public string Status;   // "REUSED" or "NEW STEEL"
    public string StockId;
    public double StockLength;
    public double Excess;
  }

  private class BuildingGeometry
  {
    public List<Line> ColumnLines = new List<Line>();
    public List<Line> BeamLines = new List<Line>();
  }

  private class Metrics
  {
    public int TotalMembers;
    public int ReusedMembers;
    public int NewMembers;
    public double TotalLength;
    public double ReusedLength;
    public double NewLength;
    public double ReusePercentage;
    public double NewSteelPercentage;
  }

  // ===================================================================
  // B. STOCK CSV PARSER
  // Expected header (source A and source B both use this schema):
  // element_id,source,material_type,section_or_species,length_ft,
  // reusable_length_ft,mass_kg,percent_reusable,embodied_carbon_savings_kgco2e
  // ===================================================================
  private List<StockItem> ParseStockCsv(string path, List<string> debugLines)
  {
    List<StockItem> items = new List<StockItem>();

    if (string.IsNullOrWhiteSpace(path))
    {
      debugLines.Add("CSV path not provided - skipped.");
      return items;
    }
    if (!File.Exists(path))
    {
      debugLines.Add("CSV file not found: " + path);
      return items;
    }

    string[] lines = File.ReadAllLines(path);
    int validCount = 0;
    int skippedCount = 0;
    string fileName = Path.GetFileName(path);

    // row 0 is the header - data starts at row 1
    for (int i = 1; i < lines.Length; i++)
    {
      string line = lines[i];
      if (string.IsNullOrWhiteSpace(line)) continue;

      string[] f = line.Split(',');
      if (f.Length < 6)
      {
        skippedCount++;
        debugLines.Add(string.Format("{0} row {1}: only {2} fields (expected >= 6) - skipped.", fileName, i + 1, f.Length));
        continue;
      }

      string id = f[0].Trim();
      string materialType = f[2].Trim();
      string section = f[3].Trim();
      string reusableLengthRaw = f[5].Trim();

      if (string.IsNullOrEmpty(id))
      {
        skippedCount++;
        debugLines.Add(string.Format("{0} row {1}: missing element_id - skipped.", fileName, i + 1));
        continue;
      }
      if (string.IsNullOrEmpty(section) || section == "#NotDesigned")
      {
        skippedCount++;
        debugLines.Add(string.Format("{0} row {1} ({2}): no usable section - skipped.", fileName, i + 1, id));
        continue;
      }
      if (!string.Equals(materialType, "Steel", StringComparison.OrdinalIgnoreCase))
      {
        skippedCount++;
        continue;
      }

      double reusableLengthFt;
      bool lengthOk = double.TryParse(reusableLengthRaw, NumberStyles.Float, CultureInfo.InvariantCulture, out reusableLengthFt);

      if (!lengthOk || reusableLengthFt <= 0.0)
      {
        skippedCount++;
        debugLines.Add(string.Format("{0} row {1} ({2}): no usable reusable_length_ft ('{3}') - skipped.", fileName, i + 1, id, reusableLengthRaw));
        continue;
      }

      items.Add(new StockItem
      {
        Id = id,
        Section = section,
        Length = reusableLengthFt * FT_TO_M,
        Used = false,
        AssignedTo = null
      });
      validCount++;
    }

    debugLines.Add(string.Format("{0}: {1} valid stock elements, {2} rows skipped (of {3} data rows).",
      fileName, validCount, skippedCount, Math.Max(0, lines.Length - 1)));

    return items;
  }

  // ===================================================================
  // C. BUILDING GEOMETRY
  // ===================================================================
  private BuildingGeometry GenerateBuilding(double span, double buildingLength, double height, int numberOfBays)
  {
    BuildingGeometry geo = new BuildingGeometry();

    double baySpacing = buildingLength / numberOfBays;
    int numberOfFrames = numberOfBays + 1;

    for (int i = 0; i < numberOfFrames; i++)
    {
      double y = i * baySpacing;

      Point3d baseLeft = new Point3d(0.0, y, 0.0);
      Point3d topLeft = new Point3d(0.0, y, height);
      Point3d baseRight = new Point3d(span, y, 0.0);
      Point3d topRight = new Point3d(span, y, height);

      geo.ColumnLines.Add(new Line(baseLeft, topLeft));
      geo.ColumnLines.Add(new Line(baseRight, topRight));
      geo.BeamLines.Add(new Line(topLeft, topRight));
    }

    return geo;
  }

  // ===================================================================
  // D. REQUIRED MEMBERS
  // ===================================================================
  private List<Member> GenerateRequiredMembers(BuildingGeometry building, string columnSection, string beamSection)
  {
    List<Member> members = new List<Member>();

    for (int i = 0; i < building.ColumnLines.Count; i++)
    {
      Line ln = building.ColumnLines[i];
      members.Add(new Member
      {
        Id = "C" + (i + 1).ToString("00"),
        Type = "column",
        Section = columnSection,
        RequiredLength = ln.Length,
        Geometry = new LineCurve(ln)
      });
    }

    for (int i = 0; i < building.BeamLines.Count; i++)
    {
      Line ln = building.BeamLines[i];
      members.Add(new Member
      {
        Id = "B" + (i + 1).ToString("00"),
        Type = "beam",
        Section = beamSection,
        RequiredLength = ln.Length,
        Geometry = new LineCurve(ln)
      });
    }

    return members;
  }

  // ===================================================================
  // E. MATCHING
  // ===================================================================
  private List<MatchResult> MatchMembersToStock(List<Member> members, List<StockItem> stock)
  {
    List<MatchResult> results = new List<MatchResult>();

    foreach (Member member in members)
    {
      StockItem best = null;
      double bestExcess = double.MaxValue;

      foreach (StockItem s in stock)
      {
        if (s.Used) continue;
        if (s.Section != member.Section) continue;
        if (s.Length < member.RequiredLength) continue;

        double excess = s.Length - member.RequiredLength;
        if (excess < bestExcess)
        {
          bestExcess = excess;
          best = s;
        }
      }

      if (best != null)
      {
        best.Used = true;
        best.AssignedTo = member.Id;

        results.Add(new MatchResult
        {
          Member = member,
          Status = "REUSED",
          StockId = best.Id,
          StockLength = best.Length,
          Excess = bestExcess
        });
      }
      else
      {
        results.Add(new MatchResult
        {
          Member = member,
          Status = "NEW STEEL",
          StockId = null,
          StockLength = 0.0,
          Excess = 0.0
        });
      }
    }

    return results;
  }

  // ===================================================================
  // F. METRICS
  // ===================================================================
  private Metrics CalculateMetrics(List<MatchResult> results)
  {
    Metrics m = new Metrics();
    m.TotalMembers = results.Count;

    foreach (MatchResult r in results)
    {
      m.TotalLength += r.Member.RequiredLength;
      if (r.Status == "REUSED")
      {
        m.ReusedMembers++;
        m.ReusedLength += r.Member.RequiredLength;
      }
      else
      {
        m.NewMembers++;
        m.NewLength += r.Member.RequiredLength;
      }
    }

    if (m.TotalLength > 0)
    {
      m.ReusePercentage = m.ReusedLength / m.TotalLength * 100.0;
      m.NewSteelPercentage = 100.0 - m.ReusePercentage;
    }

    return m;
  }

  private string FormatMatchLine(MatchResult r)
  {
    Member m = r.Member;
    if (r.Status == "REUSED")
    {
      return string.Format(
        "{0} | {1} | Required {2:0.00} m | Stock {3} | Available {4:0.00} m | REUSED",
        m.Id, m.Section, m.RequiredLength, r.StockId, r.StockLength);
    }
    return string.Format(
      "{0} | {1} | Required {2:0.00} m | No compatible stock | NEW STEEL",
      m.Id, m.Section, m.RequiredLength);
  }

  // ===================================================================
  // REPORT
  // ===================================================================
  private string GenerateReport(Metrics m, List<StockItem> stock)
  {
    int usedCount = stock.Count(s => s.Used);
    int remainingCount = stock.Count - usedCount;

    List<string> lines = new List<string>();
    lines.Add("=== PARAMETRIC STEEL BUILDING - STOCK MATCHING REPORT ===");
    lines.Add("");
    lines.Add(string.Format("Total required members : {0}", m.TotalMembers));
    lines.Add(string.Format("Reused members          : {0}", m.ReusedMembers));
    lines.Add(string.Format("New members              : {0}", m.NewMembers));
    lines.Add("");
    lines.Add(string.Format("Total required length    : {0:0.00} m", m.TotalLength));
    lines.Add(string.Format("Reused required length   : {0:0.00} m", m.ReusedLength));
    lines.Add(string.Format("New required length      : {0:0.00} m", m.NewLength));
    lines.Add("");
    lines.Add(string.Format("Reuse percentage         : {0:0.0} %", m.ReusePercentage));
    lines.Add(string.Format("New steel percentage     : {0:0.0} %", m.NewSteelPercentage));
    lines.Add("");
    lines.Add(string.Format("Stock elements available : {0}", stock.Count));
    lines.Add(string.Format("Stock elements used      : {0}", usedCount));
    lines.Add(string.Format("Stock elements remaining : {0}", remainingCount));

    return string.Join("\n", lines);
  }
}
# ---------- end c_script_2 ----------
